# Grasshopper definition SinopticoDinamico_Funcional_v0.1.gh (Grasshopper 1.0.8)
# plug-ins: RhinoCodePluginGH, EleFront, LunchBox

# ----
# 0  -  Generamos residuos EELL y escribimos en objetos.json
number_slider = Slider(1000, range=0..1000)
max_densidad = Slider(1.258, range=0..10)
max_masa = Slider(0.348, range=0.001..10)
py3 = Python3Script()  # -> out, root_path, excel_path
# ---------- py3: Python ----------
caminoGH=str(ghdoc.Path)

def dividir_quitar_unir(input_string):
    # Divide el string por el caracter "/"
    partes = input_string.split('\\')
    
    # Quita la última parte
    partes.pop()
    
    # Vuelve a unir las partes restantes
    resultado = "\\".join(partes)
    
    return resultado

root_path=dividir_quitar_unir(caminoGH)
excel_path=root_path+"\libro1.xls"
# ---------- end py3 ----------
int = Integer(number_slider)
generadortrash = GhPythonScript(camino=py3.root_path, max_densidad=max_densidad, max_masa=max_masa, m_a_simular=int)  # -> out, simplify(b), n
# ---------- generadortrash: Python ----------
import random
#import time
import json
import os

import ghpythonlib.treehelpers as th

# Definir la ruta de la carpeta raíz
#root_path = "C:\\Users\\carlo\\Documents\\GitHub\\Oficina_Urbaser\\proyecto modelo\\programasBase"
root_path = camino
# Unir la ruta de la carpeta raíz con el nombre del archivo
file_path = os.path.join(root_path, 'objetos.json')

class Objeto:
    def __init__(self):
        self.material = random.choice(['PET','PEAD','ALUMINIO','ACERO','P/C','PP','BRIK','FILM','MOR'])
        self.densidad_relativa = round(random.uniform(0.1, max_densidad), 4)
        self.masa = round(random.uniform(0.1, max_masa), 3)  # Genera una masa aleatoria entre 0.1 y 0.6
        self.humedad = round(random.uniform(0.0, 0.6), 1)
        # Genera valores aleatorios para la matriz de propiedades geométricas
        self.BoolRodante = random.choice([True, False])
        self.dimX = round(random.uniform(0.01, 1), 2)
        self.dimY = round(random.uniform(0.01, 0.5), 2)
        self.dimZ = round(random.uniform(0.01, 0.4), 2)
        #self.timestamp = time.time()
        #creamos método que averigua el maximo valor entre dimX, dimY y dimZ
        self.maxDim = max(self.dimX, self.dimY, self.dimZ)
        #creamos método que averigua volumen
        #self.volumen = self.densidad_relativa*self.masa
    def to_json(self):
        return json.dumps(self.__dict__)

# Lista para almacenar los objetos
objetos = []

# Sumatoria de masa
masa_total = 0
salidaAlimentador=[]

# Generar objetos hasta alcanzar una masa total de 100
while masa_total < m_a_simular:
    objeto = Objeto()
    objetos.append(objeto.to_json())
    salidaAlimentador.append(objeto)
    masa_total += objeto.masa

# Guardar la lista de objetos JSON en un archivo
with open(file_path, 'w') as archivo_json:
    json.dump(objetos, archivo_json)

#def lista_a_arbol(lista):
    #crear lista de listas
    #lista_listas = [list(obj.__dict__.values()) for obj in lista]
    # Convertir la lista de listas en un árbol
    #return th.list_to_tree(lista_listas, source=[0])

#crea una version de la funcion lista_a_arbol que especifique el orden de claves de diccionario de los objetos. que serán los siguienetes: dimY,densidad_relativa,dimZ,maxDim,dimX,BoolRodante,material,masa,humedad
def lista_a_arbol(lista):
    #crear lista de listas
    lista_listas = [[obj.dimY,obj.densidad_relativa,obj.dimZ,obj.maxDim,obj.dimX,obj.BoolRodante,obj.material,obj.masa,obj.humedad] for obj in lista]
    # Convertir la lista de listas en un árbol
    return th.list_to_tree(lista_listas, source=[0])

b=lista_a_arbol(salidaAlimentador)

# Imprimir la masa total y el número de objetos generados
print('Masa total acumulada: ',{masa_total})
print('Número de objetos generados: ',{len(objetos)})
n=len(objetos)
# ---------- end generadortrash ----------
panel = Panel(generadortrash.out)
panel_2 = Panel(generadortrash.n)

data_spec = DATA_SPEC(masa_total=int)  # -> R, R_2, num_3
panel_3 = Panel(data_spec.R)
kg_de_residuo = Panel(data_spec.num_3)  # disabled
recuperacion = Panel(data_spec.R_2)

# ----
# Módulos unitarios
cluster = Cluster()

listblockd = ListBlockDocument()
panel_4 = Panel(listblockd)
panel_5 = Panel(generadortrash.b)
galapagos = Galapagos(fitness=csh_flow, gene=genes)
data = Data(generadortrash.b)
# Alimentador
panel_6 = Panel("APL")
eficienciaderecuperación_so = Slider(1, range=0..1)
panel_7 = Panel("""PET
PEAD
PP
FILM
BRIK""")
eficienciaderecuperación_so_2 = Slider(1, range=0..1)
eficienciaderecuperación_so_3 = Slider(1, range=0..1)
eficienciaderecuperación_so_4 = Slider(1, range=0..1)
eficienciaderecuperación_so_5 = Slider(0.54, range=0..1)
# Salidas como función GH data tree
panel_8 = Panel("""0.00
0.0000
0.00
0.00
0.00
False
test
0.000
0.0""")

# ----
# Búsqueda parametrica de soluciones
# Genes
genes = GenePool(Decimals=1, Maximum=1, Minimum=0, Value=[0, 0.1, 0.7])

list_item = ListItem(List=genes, Index="0", Wrap=True)
domain = Domain("0.01 to 0.2")
remap_numbers = RemapNumbers(Value=list_item, Source=Domain(0, 1), Target=domain)  # -> Mapped, Clipped
panel_9 = Panel(remap_numbers.Mapped)
dumcribasb = Number(remap_numbers.Mapped)

list_item_2 = ListItem(List=genes, Index="1", Wrap=True)
domain_2 = Domain("0.01 to 0.2")
remap_numbers_2 = RemapNumbers(Value=list_item_2, Source=Domain(0, 1), Target=domain_2)  # -> Mapped, Clipped
panel_10 = Panel(remap_numbers_2.Mapped)
dimcriba0 = Number(remap_numbers_2.Mapped)

list_item_3 = ListItem(List=genes, Index="1", Wrap=True)
domain_3 = Domain("0.02 to 0.6")
remap_numbers_3 = RemapNumbers(Value=list_item_3, Source=Domain(0, 1), Target=domain_3)  # -> Mapped, Clipped
panel_11 = Panel(remap_numbers_3.Mapped)

dimcriba1 = Number(remap_numbers_3.Mapped)
number = Number(panel_9)
number_2 = Number(panel_10)
number_3 = Number(panel_10)

# ----
# Parametros de máquinas
criba_hundido_sb = Slider(0.04, range=0..0.1)
dimcriba0_tromel = Slider(0.08, range=0..0.2)
dimcriba1_tromel = Slider(0.34, range=0.2..0.6)
ef_sep_mag_rodante = Slider(1, range=0..1)
ef_sep_mag_organico = Slider(1, range=0..1)
eficienciaderecuperación_si = Slider(1, range=0..1)
eficienciaderecuperación_si_2 = Slider(1, range=0..1)
ef_sep_inductivo_organica = Data(eficienciaderecuperación_si_2)
ef_sep_inductivo_flotantes = Data(eficienciaderecuperación_si)
ef_sep_mag_organico_2 = Number(ef_sep_mag_organico)
ef_sep_mag_rodante_2 = Number(ef_sep_mag_rodante)
dumcribasb_2 = Number(dumcribasb)
dimcriba0_2 = Number(panel_10)
dimcriba1_2 = Number(dimcriba1)

tromel = Tromel(dimcriba0=dimcriba0_2, dimcriba1=dimcriba1_2, data=data)  # -> hundido0_2, hundido1_2, rebose_2
hundido0 = Data(tromel.hundido1_2)
hundido1 = Data(tromel.rebose_2)
data_2 = Data(hundido0)
ef_sep_mag_tromel = Number(ef_sep_mag_organico_2)
sb = SB(criba_hundido=dumcribasb_2, data=hundido1)  # -> hundido_sb_2, rodante_sb_2, planar_sb_2
hundido_sb = Data(sb.hundido_sb_2)
rodante_sb = Data(sb.rodante_sb_2)
colector2 = Colector2(T=data_2, T_2=hundido_sb)
s_magnetico = SMAGNETICO(eficienciaderecuperación=ef_sep_mag_tromel, data=colector2)  # -> soplado_3, venaprincipal_3
data_3 = Data(rodante_sb)
ef_sep_mag_rodante_3 = Number(ef_sep_mag_rodante_2)
ef_sep_inductivo_organica_2 = Data(ef_sep_inductivo_organica)
rebose = Data(tromel.hundido0_2)
s_magnetico_2 = SMAGNETICO(eficienciaderecuperación=ef_sep_mag_rodante_3, data=data_3)  # -> soplado_3, venaprincipal_3
planar_sb = Data(sb.planar_sb_2)
colector2_2 = Colector2(T=rebose, T_2=planar_sb)
data_4 = Data(s_magnetico.venaprincipal_3)
sep_inductivo = SEPINDUCTIVO(eficienciaderecuperación=ef_sep_inductivo_organica_2, data=data_4)  # -> soplado_3, venaprincipal_3
mor = Data(sep_inductivo.venaprincipal_3)
colector2_3 = Colector2(T=s_magnetico_2.soplado_3, T_2=s_magnetico.soplado_3)
s_óptico = SÓptico(
    eficienciaderecuperación=eficienciaderecuperación_so,
    lista_materiales_soplar=panel_7,
    data=s_magnetico_2.venaprincipal_3)  # -> soplado_3, venaprincipal_3
soplado = Data(s_óptico.soplado_3)
s_óptico_2 = SÓptico(eficienciaderecuperación=eficienciaderecuperación_so_2, lista_materiales_soplar="PET", data=soplado)  # -> soplado_3, venaprincipal_3
venaprincipal = Data(s_óptico_2.venaprincipal_3)
s_óptico_3 = SÓptico(eficienciaderecuperación=eficienciaderecuperación_so_3, lista_materiales_soplar="PEAD", data=venaprincipal)  # -> soplado_3, venaprincipal_3
venaprincipal_2 = Data(s_óptico.venaprincipal_3)
s_óptico_4 = SÓptico(eficienciaderecuperación=eficienciaderecuperación_so_4, lista_materiales_soplar="BRIK", data=s_óptico_3.venaprincipal_3)  # -> soplado_3, venaprincipal_3
ef_sep_inductivo_flotantes_2 = Data(ef_sep_inductivo_flotantes)
s_óptico_5 = SÓptico(eficienciaderecuperación=eficienciaderecuperación_so_5, lista_materiales_soplar="PP", data=s_óptico_4.venaprincipal_3)  # -> soplado_3, venaprincipal_3
soplado_2 = Data(sep_inductivo.soplado_3)
colector2_4 = Colector2(T=venaprincipal_2, T_2=s_óptico_5.venaprincipal_3)
colector2_5 = Colector2(T=colector2_2, T_2=colector2_4)
sep_inductivo_2 = SEPINDUCTIVO(eficienciaderecuperación=ef_sep_inductivo_flotantes_2, data=colector2_5)  # -> soplado_3, venaprincipal_3
soplado_3 = Data(sep_inductivo_2.soplado_3)
colector2_6 = Colector2(T=soplado_2, T_2=soplado_3)
venaprincipal_3 = Data(sep_inductivo_2.venaprincipal_3)
mor_2 = Data(mor)
acero = Data(colector2_3)
aluminio = Data(colector2_6)
pead_soplado = Data(s_óptico_3.soplado_3)
pet_soplado = Data(s_óptico_2.soplado_3)
pp_soplado = Data(s_óptico_5.soplado_3)
brik_soplado = Data(s_óptico_4.soplado_3)
pead_soplado_2 = Data(pead_soplado)
brik_soplado_2 = Data(brik_soplado)
pet_soplado_2 = Data(pet_soplado)
pp_soplado_2 = Data(pp_soplado)
rechazo = Data(venaprincipal_3)

data_spec_2 = DATA_SPEC(data=rechazo, masa_total=int)  # -> R, R_2, num_3
panel_12 = Panel(data_spec_2.R)
kg_de_residuo_2 = Panel(data_spec_2.num_3)
recuperacion_2 = Panel(data_spec_2.R_2)

cluster_2 = Cluster_2(
    T=panel_8,
    acero=acero,
    T_2=panel_8,
    aluminio=aluminio,
    T_3=panel_8,
    pead_soplado=pead_soplado_2,
    T_4=panel_8,
    pet_soplado=pet_soplado_2,
    T_5=panel_8,
    pp_soplado=pp_soplado_2,
    T_6=panel_8,
    brik_soplado=brik_soplado_2,
    T_7=panel_8,
    mor=mor_2,
    T_8=panel_8,
    rechazo=rechazo)  # -> acero_4, aluminio_4, pead_soplado_4, pet_soplado_4, pp_soplado_4, brik_soplado_4, mor_4, rechazo_4

# ----
# Resultados
panel_13 = Panel("""ACERO
ALUMINIO
PEAD
PET
PP
BRIK
MOR
RECHAZO
P/C""")
data_spec_3 = DATA_SPEC(data=cluster_2.acero_4, masa_total=int)  # -> R, R_2, num_3
data_spec_4 = DATA_SPEC(data=cluster_2.aluminio_4, masa_total=int)  # -> R, R_2, num_3
data_spec_5 = DATA_SPEC(data=cluster_2.pead_soplado_4, masa_total=int)  # -> R, R_2, num_3
data_spec_6 = DATA_SPEC(data=cluster_2.pet_soplado_4, masa_total=int)  # -> R, R_2, num_3
data_spec_7 = DATA_SPEC(data=cluster_2.pp_soplado_4, masa_total=int)  # -> R, R_2, num_3
data_spec_8 = DATA_SPEC(data=cluster_2.brik_soplado_4, masa_total=int)  # -> R, R_2, num_3
data_spec_9 = DATA_SPEC(data=cluster_2.mor_4, masa_total=int)  # -> R, R_2, num_3
data_spec_10 = DATA_SPEC(data=cluster_2.rechazo_4, masa_total=int)  # -> R, R_2, num_3
item = ListItem(List=panel_13, Index=0, Wrap=True)  # -> Item, Item1, Item2, Item3, Item4, Item5, Item6, Item7, Item8
panel_14 = Panel(item.Item)
panel_15 = Panel(item.Item3)
panel_16 = Panel(item.Item6)
panel_17 = Panel(item.Item1)
panel_18 = Panel(item.Item7)
panel_19 = Panel(item.Item5)
panel_20 = Panel(item.Item4)
panel_21 = Panel(item.Item2)
panel_22 = Panel(item.Item8)
recuperacion_3 = Panel(data_spec_10.R_2)
recuperacion_4 = Panel(data_spec_3.R_2)
recuperacion_5 = Panel(data_spec_4.R_2)
recuperacion_6 = Panel(data_spec_5.R_2)
recuperacion_7 = Panel(data_spec_6.R_2)
recuperacion_8 = Panel(data_spec_7.R_2)
recuperacion_9 = Panel(data_spec_8.R_2)
recuperacion_10 = Panel(data_spec_9.R_2)
txt = Text([panel_14, panel_17, panel_21, panel_15, panel_20, panel_19, panel_16, panel_18])
txt_2 = Text([recuperacion_4, recuperacion_5, recuperacion_6, recuperacion_7, recuperacion_8, recuperacion_9, recuperacion_10, recuperacion_3])
concat = Concatenate(FragmentA=txt_2, FragmentB="% recuperado de ", FragmentC=txt)
panel_23 = Panel(concat)

rechazo_2 = Number(data_spec_10.R_2)
masa_rechazo = Number(data_spec_10.num_3)

# ----
# visualización y exportación de datos del experimento a excel
# simulaciones grabadas
panel_24 = Panel("""220
840
230
250
223""")
num = Number(panel_24)
salidas = Number(txt_2)
parámetros_máquinas = Text([dumcribasb_2, dimcriba0_2, dimcriba1_2])
split = SplitList(List=salidas, Index=Slider(5, range=0..10))  # -> ListA, ListB
multiplication = Multiplication(A=num, B=split.ListA)  # -> flatten(Result)
panel_25 = Panel(parámetros_máquinas)
ma = MassAddition(Input=multiplication)  # -> Result, PartialResults
merge = Merge(Data1=salidas, Data2=parámetros_máquinas, Data3=ma.Result)  # -> graft(Result)
panel_26 = Panel("""ACERO
ALUMINIO
PEAD
PET
PP
BRIK
MOR
RECHAZO""")
panel_27 = Panel("""Dn criba Hundido SB
DIMCriba0_Tromel
DIMCriba1_Tromel""")
panel_28 = Panel(merge)
concat_2 = Concatenate(FragmentA="% recuperado de ", FragmentB=panel_26)
merge_2 = Merge(Data1=concat_2, Data2=panel_27, Data3="income_venta_subp")
rec = DataRecorder(merge, DataLimit=-10, RecordData=True)
path = FilePath(py3.excel_path)
data_5 = Data(merge_2)
lng = ListLength(List=data_5)
int_2 = Integer(lng)
data_6 = Data(rec)
partition = PartitionList(List=data_6, Size=int_2)  # -> simplify(Chunks)
excelwrite = ExcelWrite(
    WriteExcelData=Toggle(False),
    WorkbookPath=path,
    WorksheetName="hoja2",
    ColumnHeadings=data_5,
    Data=partition,
    ClearSheet=Toggle(True))
datagrid = CreateDataGrid(DataGridHeaders=data_5, ValueTree=partition)
panel_29 = Panel(excelwrite)

venta_de_subproductos = Number(ma.Result)
expression = Expression(x=venta_de_subproductos, y=masa_rechazo, Expression="x-(30*y)")
csh_flow = Number(expression)

# ==== cluster SB
criba_hundido = ClusterInput()
data = ClusterInput()

# ----
# Hundido
# NO hundido
# index de la propiedad que vamos a evaluar.
# maxDim
criba_hundido_2 = Slider(0.03, range=0..0.2)
criba_hundido_3 = Number(criba_hundido)
data_2 = Data(data)
item = ListItem(List=data_2, Index="3", Wrap=True)
smaller = SmallerThan(FirstNumber=item, SecondNumber=criba_hundido_3)  # -> SmallerThan, OrEqualTo
not = GateNot(A=smaller.SmallerThan)
cull = CullPattern(List=data_2, CullPattern=not)
cull_2 = CullPattern(List=data_2, CullPattern=smaller.SmallerThan)
prune = PruneTree(Tree=cull_2, Minimum="1", Maximum=0)  # -> simplify(Tree)
prune_2 = PruneTree(Tree=cull, Minimum="1", Maximum=0)  # -> simplify(Tree)
path_mapper = PathMapper(prune, source="{A}", target="{path_index}")
path_mapper_2 = PathMapper(prune_2, source="{A}", target="{path_index}")
data_3 = Data(path_mapper)
data_4 = Data(path_mapper_2)

# ----
# Rodante
# Rodante
# NO Rodante
# NO Rodante
# index de la propiedad que vamos a evaluar.
# En este caso booleano rodante
panel = Panel("5")
data_5 = Data(data_4)
item_2 = ListItem(List=data_5, Index=panel, Wrap=True)
panel_2 = Panel(item_2)
not_2 = GateNot(A=item_2)
cull_3 = CullPattern(List=data_5, CullPattern=not_2)
cull_4 = CullPattern(List=data_5, CullPattern=item_2)
prune_3 = PruneTree(Tree=cull_4, Minimum="1", Maximum=0)  # -> simplify(Tree)
prune_4 = PruneTree(Tree=cull_3, Minimum="1", Maximum=0)  # -> simplify(Tree)
path_mapper_3 = PathMapper(prune_3, source="{A}", target="{path_index}")
path_mapper_4 = PathMapper(prune_4, source="{A}", target="{path_index}")
data_6 = Data(path_mapper_3)
data_7 = Data(path_mapper_4)

# ----
# Separador Balístico
# Hundido SB
# Rodante SB
# Planar SB
hundido_sb = Data(data_3)
rodante_sb = Data(data_6)
planar_sb = Data(data_7)

planar_sb_2 = ClusterOutput(planar_sb)
rodante_sb_2 = ClusterOutput(rodante_sb)
hundido_sb_2 = ClusterOutput(hundido_sb)

# ==== cluster Tromel
data = ClusterInput()
dimcriba0 = ClusterInput()

# ----
# Hundido 0
# NO hundido 0
data_2 = Data(data)
dimcriba0_2 = Number(dimcriba0)
item = ListItem(List=data_2, Index="3", Wrap=True)
smaller = SmallerThan(FirstNumber=item, SecondNumber=dimcriba0_2)  # -> SmallerThan, OrEqualTo
not = GateNot(A=smaller.SmallerThan)
cull = CullPattern(List=data_2, CullPattern=not)
cull_2 = CullPattern(List=data_2, CullPattern=smaller.SmallerThan)
prune = PruneTree(Tree=cull_2, Minimum="1", Maximum=0)  # -> simplify(Tree)
prune_2 = PruneTree(Tree=cull, Minimum="1", Maximum=0)  # -> simplify(Tree)
path_mapper = PathMapper(prune, source="{A}", target="{path_index}")
path_mapper_2 = PathMapper(prune_2, source="{A}", target="{path_index}")
data_3 = Data(path_mapper)
data_4 = Data(path_mapper_2)

dimcriba1 = ClusterInput()

# ----
# Hundido 1
# NO hundido 1
dimcriba1_2 = Number(dimcriba1)
data_5 = Data(data_4)
item_2 = ListItem(List=data_5, Index="3", Wrap=True)
smaller_2 = SmallerThan(FirstNumber=item_2, SecondNumber=dimcriba1_2)  # -> SmallerThan, OrEqualTo
not_2 = GateNot(A=smaller_2.SmallerThan)
cull_3 = CullPattern(List=data_5, CullPattern=not_2)
cull_4 = CullPattern(List=data_5, CullPattern=smaller_2.SmallerThan)
prune_3 = PruneTree(Tree=cull_4, Minimum="1", Maximum=0)  # -> simplify(Tree)
prune_4 = PruneTree(Tree=cull_3, Minimum="1", Maximum=0)  # -> simplify(Tree)
path_mapper_3 = PathMapper(prune_3, source="{A}", target="{path_index}")
path_mapper_4 = PathMapper(prune_4, source="{A}", target="{path_index}")
data_6 = Data(path_mapper_3)
data_7 = Data(path_mapper_4)

# ----
# Trómel
# Hundido0
# Hundido1
# FILM
# NO FILM
# Rebose de tromel
txt = Text("FILM")
data_8 = Data()
panel = Panel(txt)
item_3 = ListItem(List=data_8, Index="6", Wrap=True)
tmatch = MatchText(Text=item_3, Pattern=txt, Case=True)
not_3 = GateNot(A=tmatch)
cull_5 = CullPattern(List=data_8, CullPattern=not_3)
cull_6 = CullPattern(List=data_8, CullPattern=tmatch)
prune_5 = PruneTree(Tree=cull_6, Minimum="1", Maximum=0)  # -> simplify(Tree)
prune_6 = PruneTree(Tree=cull_5, Minimum="1", Maximum=0)  # -> simplify(Tree)
path_mapper_5 = PathMapper(prune_5, source="{A}", target="{path_index}")
path_mapper_6 = PathMapper(prune_6, source="{A}", target="{path_index}")
data_9 = Data(path_mapper_5)
data_10 = Data(path_mapper_6)
t2 = Data()
t1 = Data(data_9)
hundido0 = Data(data_3)
hundido1 = Data(data_6)
rebose = Data(data_7)
t0 = Data(rebose)
colectorarboles = ColectorArboles(T=t0, T_3=t1, T_2=t2)
data_11 = Data(colectorarboles)

hundido0_2 = ClusterOutput(hundido0)
hundido1_2 = ClusterOutput(hundido1)
rebose_2 = ClusterOutput(rebose)

# ==== cluster SÓptico
lista_materiales_soplar = ClusterInput()
panel = Panel("""PET
PEAD
ACERO""")
eficienciaderecuperación = ClusterInput()
data = ClusterInput()
lista_materiales_soplar_2 = Text(lista_materiales_soplar)
data_2 = Data(data)
panel_2 = Panel(lista_materiales_soplar_2)
eficienciaderecuperación_2 = Number(eficienciaderecuperación)
# Separador Óptico Simple
# ...
# Triaje positivo:
# 
# - valorizable se saca de linea principal
# - eficiencia respecto al total de filtrados, no al total de items de entrada
eficiencia = Expression(x=eficienciaderecuperación_2, Expression="1-x")
item = ListItem(List=data_2, Index="6", Wrap=True)
tmatch = MatchText(Text=item, Pattern=lista_materiales_soplar_2, Case=True)
item_2 = ListItem(List=tmatch, Index=0, Wrap=True)  # -> Item, Item1, Item2, Item3, Item4
or = GateOr(A=item_2.Item, B=item_2.Item1, C=item_2.Item2, D=item_2.Item3, E=item_2.Item4)
# NO soplado
not = GateNot(A=or)
cull = CullPattern(List=data_2, CullPattern=not)
# soplado
cull_2 = CullPattern(List=data_2, CullPattern=or)
prune = PruneTree(Tree=cull_2, Minimum="1", Maximum=0)  # -> simplify(Tree)
prune_2 = PruneTree(Tree=cull, Minimum="1", Maximum=0)  # -> simplify(Tree)
path_mapper = PathMapper(prune, source="{A}", target="{path_index}")
path_mapper_2 = PathMapper(prune_2, source="{A}", target="{path_index}")
data_3 = Data(path_mapper)
data_4 = Data(path_mapper_2)
venaprincipal = Data(data_4)
num = Number(eficiencia)
soplado = Data(data_3)
tstat = TreeStatistics(Tree=soplado)  # -> Paths, Length, Count
multiplication = Multiplication(A=tstat.Count, B=num)
mod = Modulus(A=multiplication, B=1)
subtraction = Subtraction(A=multiplication, B=mod)
split = SplitList(List=tstat.Paths, Index=subtraction)  # -> ListA, ListB
branch = TreeBranch(Tree=soplado, Path=split.ListB, MaintainPaths=False)
branch_2 = TreeBranch(Tree=soplado, Path=split.ListA, MaintainPaths=False)
colectorarboles = ColectorArboles(T=venaprincipal, T_3=branch_2)
venaprincipal_2 = Data(colectorarboles)
soplado_2 = Data(branch)
soplado_3 = ClusterOutput(soplado_2)
venaprincipal_3 = ClusterOutput(venaprincipal_2)

# ==== cluster Colector2
T = ClusterInput()
T_2 = ClusterInput()
flatten = FlattenTree(Tree=T, Path="{0}")
flatten_2 = FlattenTree(Tree=T_2, Path="{0}")
merge = Merge(Data1=flatten, Data2=flatten_2)
partition = PartitionList(List=merge, Size=9)  # -> simplify(Chunks)
C = ClusterOutput(partition)

# ==== cluster SMAGNETICO
data = ClusterInput()
eficienciaderecuperación = ClusterInput()
data_2 = Data(data)
lista_materiales_soplar = Text("ACERO")
eficienciaderecuperación_2 = Number(eficienciaderecuperación)
# Separador magnético
eficiencia = Expression(x=eficienciaderecuperación_2, Expression="1-x")
item = ListItem(List=data_2, Index="6", Wrap=True)
tmatch = MatchText(Text=item, Pattern=lista_materiales_soplar, Case=True)
item_2 = ListItem(List=tmatch, Index=0, Wrap=True)  # -> Item, Item1, Item2, Item3
or = GateOr(A=item_2.Item, B=item_2.Item1, C=item_2.Item2, D=item_2.Item3)
# NO soplado
not = GateNot(A=or)
cull = CullPattern(List=data_2, CullPattern=not)
# soplado
cull_2 = CullPattern(List=data_2, CullPattern=or)
prune = PruneTree(Tree=cull_2, Minimum="1", Maximum=0)  # -> simplify(Tree)
prune_2 = PruneTree(Tree=cull, Minimum="1", Maximum=0)  # -> simplify(Tree)
path_mapper = PathMapper(prune, source="{A}", target="{path_index}")
path_mapper_2 = PathMapper(prune_2, source="{A}", target="{path_index}")
data_3 = Data(path_mapper)
data_4 = Data(path_mapper_2)
venaprincipal = Data(data_4)
num = Number(eficiencia)
soplado = Data(data_3)
tstat = TreeStatistics(Tree=soplado)  # -> Paths, Length, Count
multiplication = Multiplication(A=tstat.Count, B=num)
mod = Modulus(A=multiplication, B=1)
subtraction = Subtraction(A=multiplication, B=mod)
split = SplitList(List=tstat.Paths, Index=subtraction)  # -> ListA, ListB
branch = TreeBranch(Tree=soplado, Path=split.ListB, MaintainPaths=False)
branch_2 = TreeBranch(Tree=soplado, Path=split.ListA, MaintainPaths=False)
colectorarboles = ColectorArboles(T=venaprincipal, T_3=branch_2)
venaprincipal_2 = Data(colectorarboles)
soplado_2 = Data(branch)
soplado_3 = ClusterOutput(soplado_2)
venaprincipal_3 = ClusterOutput(venaprincipal_2)

# ==== cluster SEPINDUCTIVO
data = ClusterInput()
# Separador Inductivo
eficienciaderecuperación = ClusterInput()
data_2 = Data(data)
lista_materiales_soplar = Text("ALUMINIO")
eficienciaderecuperación_2 = Number(eficienciaderecuperación)
eficiencia = Expression(x=eficienciaderecuperación_2, Expression="1-x")
item = ListItem(List=data_2, Index="6", Wrap=True)
tmatch = MatchText(Text=item, Pattern=lista_materiales_soplar, Case=True)
item_2 = ListItem(List=tmatch, Index=0, Wrap=True)  # -> Item, Item1, Item2, Item3
or = GateOr(A=item_2.Item, B=item_2.Item1, C=item_2.Item2, D=item_2.Item3)
# NO soplado
not = GateNot(A=or)
cull = CullPattern(List=data_2, CullPattern=not)
# soplado
cull_2 = CullPattern(List=data_2, CullPattern=or)
prune = PruneTree(Tree=cull_2, Minimum="1", Maximum=0)  # -> simplify(Tree)
prune_2 = PruneTree(Tree=cull, Minimum="1", Maximum=0)  # -> simplify(Tree)
path_mapper = PathMapper(prune, source="{A}", target="{path_index}")
path_mapper_2 = PathMapper(prune_2, source="{A}", target="{path_index}")
data_3 = Data(path_mapper)
data_4 = Data(path_mapper_2)
venaprincipal = Data(data_4)
num = Number(eficiencia)
soplado = Data(data_3)
tstat = TreeStatistics(Tree=soplado)  # -> Paths, Length, Count
multiplication = Multiplication(A=tstat.Count, B=num)
mod = Modulus(A=multiplication, B=1)
subtraction = Subtraction(A=multiplication, B=mod)
split = SplitList(List=tstat.Paths, Index=subtraction)  # -> ListA, ListB
branch = TreeBranch(Tree=soplado, Path=split.ListB, MaintainPaths=False)
branch_2 = TreeBranch(Tree=soplado, Path=split.ListA, MaintainPaths=False)
colectorarboles = ColectorArboles(T=venaprincipal, T_3=branch_2)
venaprincipal_2 = Data(colectorarboles)
soplado_2 = Data(branch)
soplado_3 = ClusterOutput(soplado_2)
venaprincipal_3 = ClusterOutput(venaprincipal_2)

# ==== cluster DATA_SPEC
data = ClusterInput()
data_2 = Data(data)
masa_total = ClusterInput()
contadormasaagua = ContadorMasaAgua(data=data_2)
contadordemasa = ContadorDeMasa(L=data_2)
contadormateriales = ContadorMateriales(L=data_2)  # -> R_2, R
masa_total_2 = Number(masa_total)
num = Number(contadordemasa)
R = ClusterOutput(contadormateriales.R_2)
int = Integer(contadormateriales.R)
num_2 = Number(contadormasaagua)
kg_de_agua = Panel(num_2)
num_3 = ClusterOutput(num)
division = Division(A=num, B=masa_total_2)
multiplication = Multiplication(A=division, B=100)
R_2 = ClusterOutput(multiplication)

# ==== cluster Cluster
eficienciaderecuperación_so = Slider(1, range=0..1)
relay = Relay()  # disabled
relay_2 = Relay()  # disabled
panel = Panel("""PET
PEAD""")  # disabled
eficienciaderecuperación_so_2 = Slider(1, range=0..1)  # disabled
eficienciaderecuperación_so_3 = Slider(1, range=0..1)  # disabled
panel_2 = Panel("""PET
PEAD""")  # disabled
eficienciaderecuperación_so_4 = Slider(1, range=0..1)  # disabled
tstat = TreeStatistics(Tree=relay)  # -> Paths, Length, Count; disabled
tstat_2 = TreeStatistics(Tree=relay_2)  # -> Paths, Length, Count; disabled
number_slider = Slider(2.1, range=0..10)  # disabled
data = Data()  # disabled
data_2 = Data()  # disabled
data_3 = Data()  # disabled
data_4 = Data(relay)  # disabled
box = CenterBox(Base=PlaneXY(0, 0, 0), X=number_slider, Y=number_slider, Z=number_slider)  # disabled
contadormasaagua = ContadorMasaAgua(data=data)  # disabled
contadordemasa = ContadorDeMasa(L=data)  # disabled
contadormateriales = ContadorMateriales_2(L=data)  # -> R_2, R; disabled
panel_3 = Panel("""PET
PEAD
ALUMINIO
ACERO
P/C
FILM""")  # disabled
pop3d = Populate3D(Region=box, Count=tstat_2.Count, Seed=5)  # -> graft(Population); disabled
item = ListItem(List=relay_2, Index=0, Wrap=True)  # -> Item, Item1, Item2, Item3; disabled
pop3d_2 = Populate3D(Region=box, Count=tstat.Count, Seed=1)  # -> graft(Population); disabled
item_2 = ListItem(List=data_4, Index=0, Wrap=True)  # -> Item, Item1, Item2, Item3; disabled
sep_inductivo = SEPINDUCTIVO(eficienciaderecuperación=eficienciaderecuperación_so_4, data=data_3)  # -> soplado_3, venaprincipal_3; disabled
s_óptico = SÓptico_2(eficienciaderecuperación=eficienciaderecuperación_so_3, lista_materiales_soplar=panel_2)  # -> soplado_3, venaprincipal_3; disabled
eficienciaderecuperación_so_5 = Slider(1, range=0..1)  # disabled
num = Number(contadordemasa)  # disabled
int = Integer(contadormateriales.R)  # disabled
num_2 = Number(contadormasaagua)  # disabled
s_magnetico = SMAGNETICO(eficienciaderecuperación=eficienciaderecuperación_so, data=data_2)  # -> soplado_3, venaprincipal_3; disabled
xz = XZPlane(Origin=pop3d)  # disabled
s_óptico_2 = SÓptico_3(eficienciaderecuperación=eficienciaderecuperación_so_2, lista_materiales_soplar=panel)  # -> soplado_3, venaprincipal_3; disabled
sb = SB()  # -> hundido_sb_2, rodante_sb_2, planar_sb_2; disabled
tromel = Tromel_2()  # -> hundido0_2, hundido1_2, data_12; disabled
panel_4 = Panel(contadormateriales.R_2)  # disabled
kg_de_agua = Panel(num_2)  # disabled
kg_de_residuo = Panel(num)  # disabled
cyl = Cylinder(Base=xz, Radius=item.Item1, Length=item.Item2)  # disabled
panel_5 = Panel("""PET
PEAD""")  # disabled
capex = CapHolesEx(Brep=cyl)  # -> Brep, Caps, Solid; disabled
box_2 = CenterBox(Base=pop3d_2, X=item_2.Item1, Y=item_2.Item2, Z=item_2.Item3)  # -> flatten(Box); disabled
soplado = Data(sep_inductivo.soplado_3)  # disabled
scale_nu = ScaleNU(Geometry=capex.Brep, Plane=PlaneXY(0, 0, 0), ScaleX=1, ScaleY=1, ScaleZ=item.Item3)  # -> Geometry, Transform; disabled
venaprincipal = Data(sep_inductivo.venaprincipal_3)  # disabled
soplado_2 = Data(s_óptico.soplado_3)  # disabled
venaprincipal_2 = Data(s_óptico.venaprincipal_3)  # disabled
soplado_3 = Data(s_óptico_2.soplado_3)  # disabled
s_óptico_3 = SÓptico_3(eficienciaderecuperación=eficienciaderecuperación_so_5, lista_materiales_soplar=panel_5)  # -> soplado_3, venaprincipal_3; disabled
venaprincipal_3 = Data(s_óptico_2.venaprincipal_3)  # disabled
panel_6 = Panel("""dimY
densidad_relativa
dimZ
maxDim
dimX
BoolRodante
material
masa
humedad""")  # disabled
colector2 = Colector2()  # disabled
colectorarboles2 = ColectorArboles()  # disabled
mesh = Mesh(box_2)  # disabled
mesh_2 = Mesh(scale_nu.Geometry)  # disabled
soplado_4 = Data(s_magnetico.soplado_3)  # disabled
venaprincipal_4 = Data(s_magnetico.venaprincipal_3)  # disabled
colourful = Colourful(geo=mesh)  # disabled
colourful_2 = Colourful(geo=mesh_2)  # disabled
contadormateriales_2 = ContadorMateriales_2(L=soplado)  # -> R_2, R; disabled
contadormateriales_3 = ContadorMateriales_2(L=venaprincipal)  # -> R_2, R; disabled
contadormateriales_4 = ContadorMateriales_2(L=soplado_2)  # -> R_2, R; disabled
contadormateriales_5 = ContadorMateriales_2(L=venaprincipal_2)  # -> R_2, R; disabled
contadormateriales_6 = ContadorMateriales_2(L=soplado_3)  # -> R_2, R; disabled
contadormateriales_7 = ContadorMateriales_2(L=venaprincipal_3)  # -> R_2, R; disabled
brep = Brep()  # disabled
int_2 = Integer(contadormateriales_3.R)  # disabled
int_3 = Integer(contadormateriales_5.R)  # disabled
int_4 = Integer(contadormateriales_7.R)  # disabled
int_5 = Integer(contadormateriales_2.R)  # disabled
int_6 = Integer(contadormateriales_4.R)  # disabled
contadormateriales_8 = ContadorMateriales_2(L=soplado_4)  # -> R_2, R; disabled
contadormateriales_9 = ContadorMateriales_2(L=venaprincipal_4)  # -> R_2, R; disabled
int_7 = Integer(contadormateriales_6.R)  # disabled
panel_7 = Panel(contadormateriales_7.R_2)  # disabled
panel_8 = Panel(contadormateriales_3.R_2)  # disabled
panel_9 = Panel(contadormateriales_5.R_2)  # disabled
panel_10 = Panel(contadormateriales_2.R_2)  # disabled
panel_11 = Panel(contadormateriales_4.R_2)  # disabled
panel_12 = Panel(contadormateriales_6.R_2)  # disabled
int_8 = Integer(contadormateriales_9.R)  # disabled
int_9 = Integer(contadormateriales_8.R)  # disabled
panel_13 = Panel(contadormateriales_9.R_2)  # disabled
panel_14 = Panel(contadormateriales_8.R_2)  # disabled
number_slider_2 = Slider(6, range=0..10)  # disabled
Z = UnitZ(Factor=number_slider_2)  # disabled
move = Move(Geometry=brep, Motion=Z)  # -> Geometry, Transform; disabled
number_slider_3 = Slider(3, range=0..10)  # disabled
scale = Scale(Geometry=move.Geometry, Center=Point(0, 0, 0), Factor=number_slider_3)  # -> Geometry, Transform; disabled
panel_15 = Panel("""PET
PEAD
ALUMINIO
ACERO
P/C
FILM""")  # disabled
panel_16 = Panel("6")  # disabled
item_3 = ListItem(Index=panel_16, Wrap=True)  # disabled
txt = Text(panel_15)  # disabled
brep_2 = Brep(flatten(scale.Geometry))  # disabled
brep_3 = Brep([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])  # disabled
tmatch = MatchText(Text=item_3, Pattern=txt, Case=True)  # disabled
crossref = CrossReference(ListA=brep_2, ListB=brep_2, CrossMode=5)  # -> graft(ListA), graft(ListB); disabled
item_4 = ListItem(List=tmatch, Index=0, Wrap=True)  # -> flatten(Item), flatten(Item1), flatten(Item2), flatten(Item3), flatten(Item4), flatten(Item5); disabled
number_slider_4 = Slider(1, range=0..10)  # disabled
number_slider_5 = Slider(10, range=0..10)  # disabled
mesh_3 = Mesh([crossref.ListA, crossref.ListB])  # disabled
debrep = DeconstructBrep(Brep=brep_2)  # -> Faces, Edges, Vertices; disabled
item_5 = ListItem(List=mesh_3, Index=0, Wrap=True)  # -> Item, Item1; disabled
ma = MassAddition(Input=item_4.Item)  # -> Result, PartialResults; disabled
ma_2 = MassAddition(Input=item_4.Item1)  # -> Result, PartialResults; disabled
ma_3 = MassAddition(Input=item_4.Item2)  # -> Result, PartialResults; disabled
ma_4 = MassAddition(Input=item_4.Item3)  # -> Result, PartialResults; disabled
ma_5 = MassAddition(Input=item_4.Item4)  # -> Result, PartialResults; disabled
ma_6 = MassAddition(Input=item_4.Item5)  # -> Result, PartialResults; disabled
solidplanecollide = SolidPlaneCollide(Solid=brep_2, CollisionPlane=PlaneXY(0, 0, 0), Strength=number_slider_5)  # disabled
rigidbody = RigidBody(Part=graft(brep_2), Points=debrep.Vertices, Strength=3)  # -> RigidBody, Planes; disabled
grab = Grab(On=False, Strength=100, Range=3)  # -> Grab, Anchors; disabled
solidcollide = SolidCollide(MeshA=item_5.Item, MeshB=item_5.Item1, Strength=number_slider_4)  # disabled
panel_17 = Panel(ma.Result)  # disabled
panel_18 = Panel(ma_2.Result)  # disabled
panel_19 = Panel(ma_3.Result)  # disabled
panel_20 = Panel(ma_4.Result)  # disabled
panel_21 = Panel(ma_5.Result)  # disabled
panel_22 = Panel(ma_6.Result)  # disabled
pt = Point(flatten(rigidbody.Planes))  # disabled
Z_2 = UnitZ(Factor=-0.05)  # disabled
merge = Merge(Data1=panel_17, Data2=panel_18, Data3=panel_19, Data4=panel_20, Data5=panel_21, Data6=panel_22)  # disabled
panel_23 = Panel("  ")  # disabled
load = Load(Point=pt, ForceVector=Z_2)  # disabled
reset = Button()  # disabled
run = BooleanToggle(False)  # disabled
concat = Concatenate(FragmentA=panel_15, FragmentB=panel_23, FragmentC=merge)  # disabled
panel_24 = Panel(concat)  # disabled
solver_bouncy = SolverBouncy(
    GoalObjects=[load, solidplanecollide, grab.Grab, rigidbody.RigidBody, solidcollide],
    Reset=reset,
    Threshold=1e-08,
    Tolerance=0.01,
    Damping=0.98,
    Iterations=15,
    On=run)  # -> I, V, O; disabled
mesh_4 = Mesh(solver_bouncy.O)  # disabled
edges = BrepEdges(Brep=solver_bouncy.O)  # -> Naked, Interior, NonManifold; disabled
colourful_3 = Colourful(geo=mesh_4)  # disabled

# ==== cluster Cluster_2
aluminio = ClusterInput()
acero = ClusterInput()
pead_soplado = ClusterInput()
rechazo = ClusterInput()
pet_soplado = ClusterInput()
pp_soplado = ClusterInput()
brik_soplado = ClusterInput()
mor = ClusterInput()
aluminio_2 = Data(aluminio)
acero_2 = Data(acero)
pead_soplado_2 = Data(pead_soplado)
rechazo_2 = Data(rechazo)
pet_soplado_2 = Data(pet_soplado)
pp_soplado_2 = Data(pp_soplado)
brik_soplado_2 = Data(brik_soplado)
mor_2 = Data(mor)
T = ClusterInput()
T_2 = ClusterInput()
T_3 = ClusterInput()
T_4 = ClusterInput()
T_5 = ClusterInput()
T_6 = ClusterInput()
T_7 = ClusterInput()
T_8 = ClusterInput()
colector2 = Colector2(T=T, T_2=acero_2)
colector2_2 = Colector2(T=T_2, T_2=aluminio_2)
colector2_3 = Colector2(T=T_3, T_2=pead_soplado_2)
colector2_4 = Colector2(T=T_4, T_2=pet_soplado_2)
colector2_5 = Colector2(T=T_5, T_2=pp_soplado_2)
colector2_6 = Colector2(T=T_6, T_2=brik_soplado_2)
colector2_7 = Colector2(T=T_7, T_2=mor_2)
colector2_8 = Colector2(T=T_8, T_2=rechazo_2)
pead_soplado_3 = Data(colector2_3)
brik_soplado_3 = Data(colector2_6)
pet_soplado_3 = Data(colector2_4)
pp_soplado_3 = Data(colector2_5)
aluminio_3 = Data(colector2_2)
acero_3 = Data(colector2)
mor_3 = Data(colector2_7)
rechazo_3 = Data(colector2_8)
acero_4 = ClusterOutput(acero_3)
aluminio_4 = ClusterOutput(aluminio_3)
pead_soplado_4 = ClusterOutput(pead_soplado_3)
pet_soplado_4 = ClusterOutput(pet_soplado_3)
pp_soplado_4 = ClusterOutput(pp_soplado_3)
brik_soplado_4 = ClusterOutput(brik_soplado_3)
mor_4 = ClusterOutput(mor_3)
rechazo_4 = ClusterOutput(rechazo_3)

# ==== cluster ColectorArboles
T = ClusterInput()
T_2 = ClusterInput()
T_3 = ClusterInput()
flatten = FlattenTree(Tree=T, Path="{0}")
flatten_2 = FlattenTree(Tree=T_2, Path="{0}")
flatten_3 = FlattenTree(Tree=T_3, Path="{0}")
merge = Merge(Data1=flatten, Data2=flatten_3, Data3=flatten_2)
partition = PartitionList(List=merge, Size=9)  # -> simplify(Chunks)
C = ClusterOutput(partition)

# ==== cluster ContadorMateriales
panel = Panel("""PET
PEAD
ALUMINIO
ACERO
P/C
FILM
PP
BRIK
MOR""")
L = ClusterInput()
item = ListItem(List=L, Index="6", Wrap=True)
txt = Text(panel)
tmatch = MatchText(Text=item, Pattern=txt, Case=True)
item_2 = ListItem(List=tmatch, Index=0, Wrap=True)  # -> flatten(Item), flatten(Item1), flatten(Item2), flatten(Item3), flatten(Item4), flatten(Item5), flatten(Item6), flatten(Item7), flatten(Item8)
ma = MassAddition(Input=item_2.Item)  # -> Result, PartialResults
ma_2 = MassAddition(Input=item_2.Item1)  # -> Result, PartialResults
ma_3 = MassAddition(Input=item_2.Item2)  # -> Result, PartialResults
ma_4 = MassAddition(Input=item_2.Item6)  # -> Result, PartialResults
ma_5 = MassAddition(Input=item_2.Item3)  # -> Result, PartialResults
ma_6 = MassAddition(Input=item_2.Item4)  # -> Result, PartialResults
ma_7 = MassAddition(Input=item_2.Item7)  # -> Result, PartialResults
ma_8 = MassAddition(Input=item_2.Item5)  # -> Result, PartialResults
ma_9 = MassAddition(Input=item_2.Item8)  # -> Result, PartialResults
panel_2 = Panel(ma.Result)
panel_3 = Panel(ma_9.Result)
panel_4 = Panel(ma_2.Result)
panel_5 = Panel(ma_3.Result)
panel_6 = Panel(ma_5.Result)
panel_7 = Panel(ma_6.Result)
panel_8 = Panel(ma_8.Result)
panel_9 = Panel(ma_4.Result)
panel_10 = Panel(ma_7.Result)
merge = Merge(
    Data1=panel_2,
    Data2=panel_4,
    Data3=panel_5,
    Data4=panel_6,
    Data5=panel_7,
    Data6=panel_8,
    Data7=panel_9,
    Data8=panel_10,
    Data9=panel_3)
concat = Concatenate(FragmentA=panel, FragmentB="  ", FragmentC=merge)
R = ClusterOutput(merge)
R_2 = ClusterOutput(concat)

# ==== cluster ContadorDeMasa
L = ClusterInput()
item = ListItem(List=L, Index="7", Wrap=True)
nullrep = ReplaceNulls(Items=item, Replacements=Slider(0, range=0..100))  # -> flatten(Items), Count
ma = MassAddition(Input=nullrep.Items)  # -> Result, PartialResults
R = ClusterOutput(ma.Result)

# ==== cluster ContadorMasaAgua
data = ClusterInput()
data_2 = Data(data)
item = ListItem(List=data_2, Index="8", Wrap=True)
item_2 = ListItem(List=data_2, Index="7", Wrap=True)
nullrep = ReplaceNulls(Items=item, Replacements=Slider(0, range=0..100))  # -> flatten(Items), Count
nullrep_2 = ReplaceNulls(Items=item_2, Replacements=Slider(0, range=0..100))  # -> flatten(Items), Count
multiplication = Multiplication(A=nullrep.Items, B=nullrep_2.Items)
ma = MassAddition(Input=multiplication)  # -> Result, PartialResults
R = ClusterOutput(ma.Result)

# ==== cluster Colourful: Display objects in bright colours
geo = ClusterInput()
geo_2 = Geometry(geo)
clean = CleanTree(RemoveNulls=True, RemoveInvalid=True, RemoveEmpty=False, Tree=flatten(geo_2))
S = Shader([{diffuse=RGB(11, 125, 222), emission=RGB(3, 38, 67), shine=0.5, specular=RGB(255, 255, 255), transparency=0}, {diffuse=RGB(222, 37, 11), emission=RGB(67, 11, 3), shine=0.5, specular=RGB(255, 255, 255), transparency=0}, {diffuse=RGB(71, 222, 11), emission=RGB(21, 67, 3), shine=0.5, specular=RGB(255, 255, 255), transparency=0}, {diffuse=RGB(222, 194, 11), emission=RGB(67, 58, 3), shine=0.5, specular=RGB(255, 255, 255), transparency=0}])
lng = ListLength(List=clean)
repeat = RepeatData(Data=S, Length=lng)
preview = CustomPreview(Geometry=clean, Shader=repeat)

# ==== cluster ContadorMateriales_2
panel = Panel("""PET
PEAD
ALUMINIO
ACERO
P/C
FILM
PP
BRIK""")
L = ClusterInput()
item = ListItem(List=L, Index="6", Wrap=True)
txt = Text(panel)
tmatch = MatchText(Text=item, Pattern=txt, Case=True)
item_2 = ListItem(List=tmatch, Index=0, Wrap=True)  # -> flatten(Item), flatten(Item1), flatten(Item2), flatten(Item3), flatten(Item4), flatten(Item5), flatten(Item6), flatten(Item7)
ma = MassAddition(Input=item_2.Item)  # -> Result, PartialResults
ma_2 = MassAddition(Input=item_2.Item1)  # -> Result, PartialResults
ma_3 = MassAddition(Input=item_2.Item2)  # -> Result, PartialResults
ma_4 = MassAddition(Input=item_2.Item3)  # -> Result, PartialResults
ma_5 = MassAddition(Input=item_2.Item4)  # -> Result, PartialResults
ma_6 = MassAddition(Input=item_2.Item5)  # -> Result, PartialResults
ma_7 = MassAddition(Input=item_2.Item6)  # -> Result, PartialResults
ma_8 = MassAddition(Input=item_2.Item7)  # -> Result, PartialResults
panel_2 = Panel(ma.Result)
panel_3 = Panel(ma_2.Result)
panel_4 = Panel(ma_3.Result)
panel_5 = Panel(ma_4.Result)
panel_6 = Panel(ma_5.Result)
panel_7 = Panel(ma_6.Result)
panel_8 = Panel(ma_7.Result)
panel_9 = Panel(ma_8.Result)
merge = Merge(Data1=panel_2, Data2=panel_3, Data3=panel_4, Data4=panel_5, Data5=panel_6, Data6=panel_7, Data7=panel_8, Data8=panel_9)
concat = Concatenate(FragmentA=panel, FragmentB="  ", FragmentC=merge)
R = ClusterOutput(merge)
R_2 = ClusterOutput(concat)

# ==== cluster SÓptico_2
lista_materiales_soplar = ClusterInput()
eficienciaderecuperación = ClusterInput()
data = ClusterInput()
panel = Panel("""PET
PEAD
ACERO""")
lista_materiales_soplar_2 = Text(lista_materiales_soplar)
eficienciaderecuperación_2 = Number(eficienciaderecuperación)
data_2 = Data(data)
# Separador Óptico Simple
# ...
# Triaje positivo:
# 
# - valorizable se saca de linea principal
# - eficiencia respecto al total de filtrados, no al total de items de entrada
eficiencia = Expression(x=eficienciaderecuperación_2, Expression="1-x")
item = ListItem(List=data_2, Index="6", Wrap=True)
tmatch = MatchText(Text=item, Pattern=lista_materiales_soplar_2, Case=True)
item_2 = ListItem(List=tmatch, Index=0, Wrap=True)  # -> Item, Item1, Item2, Item3
or = GateOr(A=item_2.Item, B=item_2.Item1, C=item_2.Item2, D=item_2.Item3)
# NO soplado
not = GateNot(A=or)
cull = CullPattern(List=data_2, CullPattern=not)
# soplado
cull_2 = CullPattern(List=data_2, CullPattern=or)
prune = PruneTree(Tree=cull_2, Minimum="1", Maximum=0)  # -> simplify(Tree)
prune_2 = PruneTree(Tree=cull, Minimum="1", Maximum=0)  # -> simplify(Tree)
path_mapper = PathMapper(prune, source="{A}", target="{path_index}")
path_mapper_2 = PathMapper(prune_2, source="{A}", target="{path_index}")
data_3 = Data(path_mapper)
data_4 = Data(path_mapper_2)
venaprincipal = Data(data_4)
num = Number(eficiencia)
soplado = Data(data_3)
tstat = TreeStatistics(Tree=soplado)  # -> Paths, Length, Count
multiplication = Multiplication(A=tstat.Count, B=num)
mod = Modulus(A=multiplication, B=1)
subtraction = Subtraction(A=multiplication, B=mod)
split = SplitList(List=tstat.Paths, Index=subtraction)  # -> ListA, ListB
branch = TreeBranch(Tree=soplado, Path=split.ListB, MaintainPaths=False)
branch_2 = TreeBranch(Tree=soplado, Path=split.ListA, MaintainPaths=False)
colectorarboles = ColectorArboles(T=venaprincipal, T_3=branch_2)
venaprincipal_2 = Data(colectorarboles)
soplado_2 = Data(branch)
soplado_3 = ClusterOutput(soplado_2)
venaprincipal_3 = ClusterOutput(venaprincipal_2)

# ==== cluster SÓptico_3
lista_materiales_soplar = ClusterInput()
eficienciaderecuperación = ClusterInput()
data = ClusterInput()
panel = Panel("""PET
PEAD
ACERO""")
lista_materiales_soplar_2 = Text(lista_materiales_soplar)
eficienciaderecuperación_2 = Number(eficienciaderecuperación)
data_2 = Data(data)
# Separador Óptico Simple
# ...
# Triaje negativo:
# 
# - valorizable se deja en linea principal
eficiencia = Expression(x=eficienciaderecuperación_2, Expression="1-x")
item = ListItem(List=data_2, Index="6", Wrap=True)
tmatch = MatchText(Text=item, Pattern=lista_materiales_soplar_2, Case=True)
item_2 = ListItem(List=tmatch, Index=0, Wrap=True)  # -> Item, Item1, Item2, Item3
or = GateOr(A=item_2.Item, B=item_2.Item1, C=item_2.Item2, D=item_2.Item3)
# NO soplado
not = GateNot(A=or)
cull = CullPattern(List=data_2, CullPattern=not)
# soplado
cull_2 = CullPattern(List=data_2, CullPattern=or)
prune = PruneTree(Tree=cull, Minimum="1", Maximum=0)  # -> simplify(Tree)
prune_2 = PruneTree(Tree=cull_2, Minimum="1", Maximum=0)  # -> simplify(Tree)
path_mapper = PathMapper(prune, source="{A}", target="{path_index}")
path_mapper_2 = PathMapper(prune_2, source="{A}", target="{path_index}")
data_3 = Data(path_mapper)
data_4 = Data(path_mapper_2)
venaprincipal = Data(data_4)
num = Number(eficiencia)
soplado = Data(data_3)
tstat = TreeStatistics(Tree=soplado)  # -> Paths, Length, Count
multiplication = Multiplication(A=tstat.Count, B=num)
mod = Modulus(A=multiplication, B=1)
subtraction = Subtraction(A=multiplication, B=mod)
split = SplitList(List=tstat.Paths, Index=subtraction)  # -> ListA, ListB
branch = TreeBranch(Tree=soplado, Path=split.ListB, MaintainPaths=False)
branch_2 = TreeBranch(Tree=soplado, Path=split.ListA, MaintainPaths=False)
colectorarboles = ColectorArboles(T=venaprincipal, T_3=branch_2)
venaprincipal_2 = Data(colectorarboles)
soplado_2 = Data(branch)
soplado_3 = ClusterOutput(soplado_2)
venaprincipal_3 = ClusterOutput(venaprincipal_2)

# ==== cluster Tromel_2
data = ClusterInput()

# ----
# FILM
# NO FILM
data_2 = Data(data)
txt = Text("FILM")
panel = Panel(txt)
item = ListItem(List=data_2, Index="6", Wrap=True)
tmatch = MatchText(Text=item, Pattern=txt, Case=True)
not = GateNot(A=tmatch)
cull = CullPattern(List=data_2, CullPattern=not)
cull_2 = CullPattern(List=data_2, CullPattern=tmatch)
prune = PruneTree(Tree=cull_2, Minimum="1", Maximum=0)  # -> simplify(Tree)
prune_2 = PruneTree(Tree=cull, Minimum="1", Maximum=0)  # -> simplify(Tree)
path_mapper = PathMapper(prune, source="{A}", target="{path_index}")
path_mapper_2 = PathMapper(prune_2, source="{A}", target="{path_index}")
data_3 = Data(path_mapper)
data_4 = Data(path_mapper_2)

dimcriba0 = ClusterInput()

# ----
# Hundido 0
# NO hundido 0
data_5 = Data(data_4)
dimcriba0_2 = Number(dimcriba0)
item_2 = ListItem(List=data_5, Index="3", Wrap=True)
smaller = SmallerThan(FirstNumber=item_2, SecondNumber=dimcriba0_2)  # -> SmallerThan, OrEqualTo
not_2 = GateNot(A=smaller.SmallerThan)
cull_3 = CullPattern(List=data_5, CullPattern=not_2)
cull_4 = CullPattern(List=data_5, CullPattern=smaller.SmallerThan)
prune_3 = PruneTree(Tree=cull_4, Minimum="1", Maximum=0)  # -> simplify(Tree)
prune_4 = PruneTree(Tree=cull_3, Minimum="1", Maximum=0)  # -> simplify(Tree)
path_mapper_3 = PathMapper(prune_3, source="{A}", target="{path_index}")
path_mapper_4 = PathMapper(prune_4, source="{A}", target="{path_index}")
data_6 = Data(path_mapper_3)
data_7 = Data(path_mapper_4)

dimcriba1 = ClusterInput()

# ----
# Hundido 1
# NO hundido 1
dimcriba1_2 = Number(dimcriba1)
data_8 = Data(data_7)
item_3 = ListItem(List=data_8, Index="3", Wrap=True)
smaller_2 = SmallerThan(FirstNumber=item_3, SecondNumber=dimcriba1_2)  # -> SmallerThan, OrEqualTo
not_3 = GateNot(A=smaller_2.SmallerThan)
cull_5 = CullPattern(List=data_8, CullPattern=not_3)
cull_6 = CullPattern(List=data_8, CullPattern=smaller_2.SmallerThan)
prune_5 = PruneTree(Tree=cull_6, Minimum="1", Maximum=0)  # -> simplify(Tree)
prune_6 = PruneTree(Tree=cull_5, Minimum="1", Maximum=0)  # -> simplify(Tree)
path_mapper_5 = PathMapper(prune_5, source="{A}", target="{path_index}")
path_mapper_6 = PathMapper(prune_6, source="{A}", target="{path_index}")
data_9 = Data(path_mapper_5)
data_10 = Data(path_mapper_6)

# ----
# Trómel
# Hundido0
# Hundido1
# Rebose de tromel
t2 = Data()
t1 = Data(data_3)
hundido0 = Data(data_6)
hundido1 = Data(data_9)
rebose = Data(data_10)
t0 = Data(rebose)
colectorarboles = ColectorArboles(T=t0, T_3=t1, T_2=t2)
data_11 = Data(colectorarboles)

data_12 = ClusterOutput(data_11)
hundido0_2 = ClusterOutput(hundido0)
hundido1_2 = ClusterOutput(hundido1)
